# Grasshopper definition MPDA22-session03_hops.gh (Grasshopper 1.0.7)
# plug-ins: Kangaroo2 Components

subd = SubD(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)
meshsubd = MeshFromSubD(SubD=subd, Density=Slider(0, range=0..2))
triremesh = TriRemesh(Geometry=meshsubd, Length=Slider(2, range=1..2), Iterations=25)  # -> Triangulation, Dual, Creases
data = Data(triremesh.Triangulation)
data_2 = Data(meshsubd)
clean = CombineClean(Meshes=data_2)
explodemesh = GhPythonScript(m=clean)  # -> out, a; inputs m: Mesh
# ---------- explodemesh: Python ----------
import Rhino.Geometry as rg

ghenv.Component.Message = "explode mesh"

exploded = []

for i in range(m.Faces.Count):
    m_copy = m.Duplicate()
    face = m_copy.Faces.ExtractFaces([i])
    exploded.append(face)
    
a = exploded
# ---------- end explodemesh ----------
